# Grasshopper definition unnamed.gh (Grasshopper 1.0.7)

curve = Curve(<curve referenced from the Rhino model>)
curve_2 = Curve(<curve referenced from the Rhino model>)
point = Point([<point referenced from the Rhino model> x5])
point_2 = Point([Point(-17.64926555, 8.344287289, 0), Point(-4.474075092, 8.838356931, 0), Point(-18.74719809, 1.811588688, 0), Point(-3.485935808, 1.59200218, 0)])
c_script = CSharpScript(x=point, y=curve_2)  # -> out, A; inputs x: list of Point3d, y: Curve
# ---------- c_script: C# ----------
    var sort = Point3d.SortAndCullPointList(x, 0.001);
    A = new Polyline(sort);
# ---------- end c_script ----------
panel = Panel(c_script.A)
